# Dynamo custom node Element.ParameterExists.dyf (Dynamo 0.7.5.3566)
# category: Clockwork.Revit.Elements.Element.Query
# Checks if an element contains a parameter of a given name

Element_s = Input()  # "Element(s)"
turn_into_list = Custom[Turn Into List](item=Element_s)  # Turns an element (or a nested list) into a flat list
param = Input()
python_script = Python(IN[0]=turn_into_list, IN[1]=param)
# ---------- python_script.python (28 lines) ----------
# This node was originally created by Andreas Dieckmann
# and only updated by Konrad K Sobon to work with Revit 2016

# Copyright(c) 2015, Konrad K Sobon
# @arch_laboratory, http://archi-lab.net

# Modified to Clockwork coding style by Andreas Dieckmann

import clr
clr.AddReference('RevitAPI')
from Autodesk.Revit.DB import *

items = UnwrapElement(IN[0])
param = IN[1]
elementList = []

for item in items:
	try:
		params = item.Parameters
		paramNames = [i.Definition.Name for i in params]
		if param in paramNames:
			elementList.append(True)
		else:
			elementList.append(False)
	except:
		elementList.append(False)

OUT = elementList
# ----------------------------------------
returnListOrSingleValue = Custom[ReturnListOrSingleValue](item_1_unknown=Element_s, item_2_list=python_script)  # If the item in input #1 is not a list, only the first item of the list in input #2 will be returned.
bool = Output(returnListOrSingleValue)
