# Dynamo graph AngleByAngleSum.dyn (Dynamo 0.6.3.7375)

# note: This example also requires the Unit Conversion package to be installed.
angle_1 = DoubleSliderInput(45, range=0..120)
degrees_to_radians = Custom[Degrees To Radians](deg=angle_1)  # Converts degrees into radians
angle_2 = DoubleSliderInput(90, range=0..120)
degrees_to_radians_2 = Custom[Degrees To Radians](deg=angle_2)
angle_3 = DoubleSliderInput(75, range=0..120)
degrees_to_radians_3 = Custom[Degrees To Radians](deg=angle_3)
list = NewList(index0=degrees_to_radians, index1=degrees_to_radians_2, index2=degrees_to_radians_3)
angle_by_angle_sum = Custom[Angle By Angle Sum](list=list)  # Computes the missing interior angle of a *planar* polygon based on a given list of all other interior angles.
radians_to_degrees = Custom[Radians To Degrees](rad=angle_by_angle_sum)  # Converts radians into degrees
watch = Watch(radians_to_degrees)
