# Dynamo graph IntersectsForDividedSurfaces.dyn (Dynamo 0.6.3.7375)

select_face = FormElementBySelection()  # 1 picked in the model
formula = Formula("1", lacing=Longest)
divided_surface = DividedSurface(select_face, formula, formula, lacing=Longest)
# note: This example will also need the Unit Conversion package to be installed.
scale = DoubleSliderInput(15.285, range=0..20)
meters_to_feet = Custom[Meters To Feet](m=scale)  # Converts meters into feet
select_reference_point = PointBySelection()  # 1 picked in the model
xyz_from_reference_point = XyzFromReferencePoint(select_reference_point, lacing=Longest)
select_reference_point_2 = PointBySelection()  # 1 picked in the model
xyz_from_reference_point_2 = XyzFromReferencePoint(select_reference_point_2, lacing=Longest)
subdivisions_vertical_ref_planes = IntegerSliderInput(13, range=2..30)
string = StringInput("dynamo_intersect_V")
vertical_intersects_for_divided = Custom[Vertical Intersects for Divided Surface by Endpoints](DivSurf=divided_surface, Scale=meters_to_feet, XYZ_Start=xyz_from_reference_point, XYZ_End=xyz_from_reference_point_2, Subdivisions=subdivisions_vertical_ref_planes, Intersect_Name=string)  # Creates a number of equally spaced vertical intersects for a divided surface based on the path between between two points
watch = Watch(vertical_intersects_for_divided.DivSurf)
watch_2 = Watch(vertical_intersects_for_divided.Intersects)
select_reference_point_3 = PointBySelection()  # 1 picked in the model
xyz_from_reference_point_3 = XyzFromReferencePoint(select_reference_point_3, lacing=Longest)
select_reference_point_4 = PointBySelection()  # 1 picked in the model
xyz_from_reference_point_4 = XyzFromReferencePoint(select_reference_point_4, lacing=Longest)
subdivisions_horizontal_levels = IntegerSliderInput(6, range=0..30)
level_name_prefix = StringInput("dynamo_intersect_H")
horizontal_intersects_for = Custom[Horizontal Intersects For Divided Surface by Endpoints](DivSurf=divided_surface, XYZ_Start=xyz_from_reference_point_3, XYZ_End=xyz_from_reference_point_4, Subdivisions=subdivisions_horizontal_levels, Intersect_Name=level_name_prefix)  # Creates a number of equally spaced horizontal intersects for a divided surface based on the path between between two points
watch_3 = Watch(horizontal_intersects_for.DivSurf)
watch_4 = Watch(horizontal_intersects_for.Intersects)
select_elements = MultipleCurvesBySelection()  # 1 picked in the model
add_intersect_to_divided_surface = Custom[Add Intersect To Divided Surface](DivSurf=divided_surface, Element_s=select_elements)  # Adds an intersect to a divided surface
watch_5 = Watch(add_intersect_to_divided_surface)
