# Dynamo graph MappableConditions.dyn (Dynamo 0.6.3.7375)

number = DoubleInput(5)
boolean = BoolSelector(true)
boolean_2 = BoolSelector(false)
if_x_greater_than = Custom[If X Greater Than](y=number, true=boolean, false=boolean_2)  # If X > Y as a mappable function
number_2 = DoubleInput(1..10)
map = Map(if_x_greater_than, number_2)
watch = Watch(map)
if_x_greater_than_or_equal = Custom[If X Greater Than Or Equal](y=number, true=boolean, false=boolean_2)  # If X >= Y as a mappable function
map_2 = Map(if_x_greater_than_or_equal, number_2)
watch_2 = Watch(map_2)
if_x_equal = Custom[If X Equal](y=number, true=boolean, false=boolean_2)  # If X = Y as a mappable function
map_3 = Map(if_x_equal, number_2)
watch_3 = Watch(map_3)
if_x_less_than_or_equal = Custom[If X Less Than Or Equal](y=number, true=boolean, false=boolean_2)  # If X <= Y as a mappable function
map_4 = Map(if_x_less_than_or_equal, number_2)
watch_4 = Watch(map_4)
if_x_less_than = Custom[If X Less Than](y=number, true=boolean, false=boolean_2)  # If X < Y as a mappable function
map_5 = Map(if_x_less_than, number_2)
watch_5 = Watch(map_5)
