# Dynamo graph MatchListWithKeysAndValues.dyn (Dynamo 0.6.3.7375)

number = DoubleInput(2)
number_2 = DoubleInput(5)
number_3 = DoubleInput(6)
list = NewList(index0=number, index1=number_2, index2=number_3)
number_4 = DoubleInput(1..8)
string = StringInput("Apples")
string_2 = StringInput("Pears")
string_3 = StringInput("Oranges")
string_4 = StringInput("Peaches")
string_5 = StringInput("Bananas")
string_6 = StringInput("Strawberries")
string_7 = StringInput("Pineapples")
string_8 = StringInput("Mangos")
list_2 = NewList(index0=string, index1=string_2, index2=string_3, index3=string_4, index4=string_5, index5=string_6, index6=string_7, index7=string_8)
match_list_with_key_values = Custom[Match List With Key Values](list=list, keys=number_4, values=list_2)  # Matches a list with a given set of keys and returns the values corresponding to the keys
watch = Watch(match_list_with_key_values)
