# Dynamo graph TriangularFlatDiagonal.dyn (Dynamo 0.6.3.7375)

# note: This example also requires the XYZ Grid From Face package to be installed.
select_face = FormElementBySelection()  # 1 picked in the model
U = IntegerSliderInput(5, range=0..20)
V = IntegerSliderInput(3, range=0..20)
uv_xyz_grid_from_face = Custom[UV/XYZ Grid From Face](face=select_face, U=U, V=V)  # Returns UV coordinates, XYZ coordinates and normals for a face with UV subdivision
reverse_a = BoolSelector(false)
reverse_b = BoolSelector(false)
shift_placement_a = IntegerSliderInput(0, range=0..2)
shift_placement_b = IntegerSliderInput(0, range=0..2)
shift_overall_placement = IntegerSliderInput(0, range=0..2)
rotate_grid_by_90 = BoolSelector(true)
triangular_pattern_flat_diagonal = Custom[Triangular Pattern (Flat, Diagonal) From Grid](list=uv_xyz_grid_from_face.UVs, V=V, reverse_triangle_A=reverse_a, reverse_triangle_B=reverse_b, shift_placement_triangle_A=shift_placement_a, shift_placement_triangle_B=shift_placement_b, shift_overall_placement=shift_overall_placement, rotate_grid_by_90=rotate_grid_by_90)  # Creates groups of points from a list of UVs or XYZs for the placement of triangular panels. The placement pattern can be reversed (boolean) and shifted (integer).
select_family_type = FamilyTypeSelector(index=1)
adaptive_component_by_uvs_on = AdaptiveComponentByUvsOnFace(triangular_pattern_flat_diagonal.list_triangle_A, select_face, select_family_type, lacing=Longest)
select_family_type_2 = FamilyTypeSelector(index=1)
adaptive_component_by_uvs_on_2 = AdaptiveComponentByUvsOnFace(triangular_pattern_flat_diagonal.list_triangle_B, select_face, select_family_type_2, lacing=Longest)
