# Dynamo graph TrueAndFalseForAnyAndAll.dyn (Dynamo 0.6.3.7375)

boolean = BoolSelector(false)
boolean_2 = BoolSelector(true)
list = NewList(index0=boolean, index1=boolean_2)
true_for_any_boolean = Custom[True For Any (Boolean)](seq=list)  # Returns true if any item in a list of booleans is true.
watch = Watch(true_for_any_boolean)
true_for_all_boolean = Custom[True For All (Boolean)](seq=list)  # Returns true if all items in a list of booleans are true.
watch_2 = Watch(true_for_all_boolean)
false_for_any_boolean = Custom[False For Any (Boolean)](seq=list)  # Returns true if any item in a list of booleans is false.
watch_3 = Watch(false_for_any_boolean)
false_for_all_boolean = Custom[False For All (Boolean)](seq=list)  # Returns true if all items in a list of booleans are false.
watch_4 = Watch(false_for_all_boolean)
