# Dynamo graph UnitConversion.dyn (Dynamo 0.6.3.7375)

integer_slider = IntegerSliderInput(50, range=0..360)
degrees_to_radians = Custom[Degrees To Radians](deg=integer_slider)  # Converts degrees into radians
watch = Watch(degrees_to_radians)
radians_to_degrees = Custom[Radians To Degrees](rad=watch)  # Converts radians into degrees
watch_2 = Watch(radians_to_degrees)
integer_slider_2 = IntegerSliderInput(50, range=0..5000)
millimeters_to_feet = Custom[Millimeters To Feet](mm=integer_slider_2)  # Converts millimeters into feet
watch_3 = Watch(millimeters_to_feet)
feet_to_millimeters = Custom[Feet To Millimeters](ft=watch_3)  # Converts feet into millimeters
watch_4 = Watch(feet_to_millimeters)
integer_slider_3 = IntegerSliderInput(239, range=0..500)
centimeters_to_feet = Custom[Centimeters To Feet](cm=integer_slider_3)  # Converts centimeters into feet
watch_5 = Watch(centimeters_to_feet)
feet_to_centimeters = Custom[Feet To Centimeters](ft=watch_5)  # Converts feet into centimeters
watch_6 = Watch(feet_to_centimeters)
number_slider = DoubleSliderInput(30.295, range=0..50)
watch_7 = Watch(number_slider)
meters_to_feet = Custom[Meters To Feet](m=watch_7)  # Converts meters into feet
watch_8 = Watch(meters_to_feet)
feet_to_meters = Custom[Feet To Meters](ft=watch_8)  # Converts feet into meters
watch_9 = Watch(feet_to_meters)
number_slider_2 = DoubleSliderInput(14.3, range=0..20)
watch_10 = Watch(number_slider_2)
square_meters_to_square_feet = Custom[Square Meters To Square Feet](m2=watch_10)  # Converts square meters into square feet
watch_11 = Watch(square_meters_to_square_feet)
square_feet_to_square_meters = Custom[Square Feet To Square Meters](sq_ft=watch_11)  # Converts square feet into square meters
watch_12 = Watch(square_feet_to_square_meters)
number_slider_3 = DoubleSliderInput(9.5, range=0..20)
watch_13 = Watch(number_slider_3)
cubic_meters_to_cubic_feet = Custom[Cubic Meters To Cubic Feet](m3=watch_13)  # Converts cubic meters into cubic feet
watch_14 = Watch(cubic_meters_to_cubic_feet)
cubic_feet_to_cubic_meters = Custom[Cubic Feet To Cubic Meters](cu_ft=watch_14)  # Converts cubic feet into cubic meters
watch_15 = Watch(cubic_feet_to_cubic_meters)
