# Dynamo graph UVAndXYZGridFromFace.dyn (Dynamo 0.6.3.7375)

select_face = FormElementBySelection()  # 1 picked in the model
U = IntegerSliderInput(10, range=0..20)
V = IntegerSliderInput(10, range=0..20)
uv_and_xyz_grid_from_face = Custom[UV And XYZ Grid From Face](face=select_face, U=U, V=V)  # Returns UV coordinates, XYZ coordinates and normals for a face with UV subdivision
watch = Watch(uv_and_xyz_grid_from_face.XYZs)
watch_2 = Watch(uv_and_xyz_grid_from_face.Normals)
watch_3 = Watch(uv_and_xyz_grid_from_face.UVs)
watch_3d = Watch3D(uv_and_xyz_grid_from_face.UVs)
