# Dynamo graph FamilyTypeFromImage_AC.dyn (Dynamo 0.7.0.28161)

# note: 1 = Distribute UV field by formula (only non-planar non-revolved surfaces)
# 0 = Distribute a regularly spaced UV field (all surfaces)
distribution_method = BoolSelector(true)
UV = Uv()
# note: This formula drives the subdivision for the U values. You can substitute this with any formula that will return results in the range of 0 to 1 for inputs in the range of 0 to 1. For a linear sequence simply shorten the formula to just "u".
formula_u = Formula("Sin(u*Pi/2)")
# note: This definition works more or less similar as the Parameter Values From Image definition, except that it will distribute adaptive components across a surface and set one of their instance parameters according to an image.
# The definition will let you pick a face, specify the number of UV divisions and populate it with adaptive components. You can either create linear subdivisions (all types of surfaces) or have the subdivisions driven by a formula using the NormalizedSequenceByFunction node (currently only non-planar non revolved surfaces). Use an image file to drive the family type of each placed component.
# For questions email me at dieckmann@caad.arch.rwth-aachen.de
# First published here:
# http://autodeskvasari.com/forum/topics/parameter-values-from-image-for-dynamo
# note: REQUIRED PACKAGES:
# - Mappable Conditions
# - Invert And Mirror Normalized Values
# - Simple Patterning
# - XYZ Grid From Face
U = IntegerSliderInput(20, range=0..20)
n1 = Custom[+1](U)  # Increments a value by 1
normalized_sequence_by_function = Custom[Normalized Sequence by Function](f_x=formula_u, N=n1)  # Creates a sequence of N values between 0 and 1 driven by a function
# note: For information on formula see above
formula_v = Formula("Sin(v*Pi/2)")
V = IntegerSliderInput(20, range=0..20)
n1_2 = Custom[+1](V)
normalized_sequence_by_function_2 = Custom[Normalized Sequence by Function](f_x=formula_v, N=n1_2)
# note: Distribution of UV grid by formula
cartesian_product = CartProd(UV, normalized_sequence_by_function, normalized_sequence_by_function_2)
# note: The face you want to populate
select_face = FormElementBySelection()
# note: Regular distribution of UV grid
uv_and_xyz_grid_from_face = Custom[UV And XYZ Grid From Face](face=select_face, U=U, V=V)  # Returns UV coordinates, XYZ coordinates and normals for a face with UV subdivision
if_ = Conditional(distribution_method, cartesian_product, uv_and_xyz_grid_from_face.UVs)
reverse_placement_point_order = BoolSelector(false)
shift_placement_point_order = IntegerSliderInput(3, range=0..3)
# note: Create placement patterns for quadrilateral panels
quadrilateral_pattern_from_grid = Custom[Quadrilateral Pattern From Grid](list=if_, V=V, reverse=reverse_placement_point_order, shift_placement=shift_placement_point_order)  # Creates groups of points from a list of UVs or XYZs for the placement of quadrilateral panels. The placement pattern can be reversed (boolean) and shifted (integer).
# note: Threshold value that determines which pixels are counted as black and which pixels are counted as white
black_white_threshold = DoubleSliderInput(0.5, range=0..1)
# note: For *light* pixels.
# This can be any 4-point Adaptive Component loaded in the family. You could also use AC's with more or fewer placement points, but then you'd have to change the placement pattern in the Build Sublists node in the center of the workspace and change the number of placement points below.
select_adaptive_component_1 = FamilyTypeSelector(index=0)
# note: For *dark* pixels.
# (Also see note above)
select_adaptive_component_2 = FamilyTypeSelector(index=1)
if_x_greater_than = Custom[If X Greater Than](y=black_white_threshold, true=select_adaptive_component_1, false=select_adaptive_component_2)  # If X > Y as a mappable function
path_to_image_file = StringFilename("No file selected.")
# note: Get an appropriate number of samples from the image file
read_image_file = ImageFileReader(path_to_image_file, V, U)
# note: Replace this with a Color Saturation or Color Hue node for different effects
color_brightness = ColorBrightness(read_image_file, lacing=Longest)
# note: Some basic image manipulation options
invert_image_data = BoolSelector(false)
mirror_image_vertically = BoolSelector(true)
mirror_image_horizontally = BoolSelector(true)
invert_and_mirror_normalized = Custom[Invert And Mirror Normalized Values](list=color_brightness, Invert=invert_image_data, Mirror_Vertically=mirror_image_vertically, Mirror_Horizontally=mirror_image_horizontally, X=V)  # Inverts and mirrors (horizontally & vertically) a list of normalized values.
# note: Set component type according to pixel and threshold values
map = Map(if_x_greater_than, invert_and_mirror_normalized)
# note: Create Adaptive Components from list and set type according to image pattern.
adaptive_component_by_uvs_on = AdaptiveComponentByUvsOnFace(quadrilateral_pattern_from_grid, select_face, map, lacing=Longest)
