# Dynamo graph ParameterValuesFromImage_DS.dyn (Dynamo 0.7.0.36088)

# note: This definition works like the Parameter Values From Image plugin for Vasari. Additionally you can invert and mirror (vertically and horizontally) the image data.
# For questions email me at dieckmann@caad.arch.rwth-aachen.de
# First published here: http://autodeskvasari.com/forum/topics/parameter-values-from-image-for-dynamo
# note: You will actually have to select the underlying form element / face, not the divided surface itself.
select_divided_surface = DividedSurfaceBySelection()
flatten_completely = FlattenList(select_divided_surface)
# note: The name of the instance parameter that is to be driven by the image data
parameter_name = StringInput("controller")
path_to_image_file = StringFilename("No file selected.")
# note: REQUIRED PACKAGES:
# - Invert And Mirror Normalized Values
# - Get Highest And Lowest From List
# - Sublist Helpers
get_sublist_lengths = Custom[Get Sublist Lengths](list=select_divided_surface)  # Gets the lengths of all sublists in a given list of lists.
# note: Determine U/X
get_highest_and_lowest_from_list = Custom[Get Highest And Lowest From List](list=get_sublist_lengths)  # Gets the highest and lowest value from a given list
# note: Determine V/Y
list_length = Length(select_divided_surface)
read_image_file = ImageFileReader(path_to_image_file, get_highest_and_lowest_from_list.highest, list_length)
# note: Replace this with Color Hue or Color Saturation for different effects
color_brightness = ColorBrightness(read_image_file, lacing=Longest)
# note: Some image-related settings
invert_image_data = BoolSelector(false)
mirror_vertically = BoolSelector(false)
mirror_horizontally = BoolSelector(true)
invert_and_mirror_normalized = Custom[Invert And Mirror Normalized Values](list=color_brightness, Invert=invert_image_data, Mirror_Vertically=mirror_vertically, Mirror_Horizontally=mirror_horizontally, X=get_highest_and_lowest_from_list.highest)  # Inverts and mirrors (horizontally & vertically) a list of normalized values.
set_family_instance_parameter = FamilyInstanceParameterSetter(flatten_completely, parameter_name, invert_and_mirror_normalized, lacing=Longest)
